# Grasshopper definition create-regular-trabecular-grid.gh (Grasshopper 0.9.76)

C = Cell({Plane=PlaneXY(-25, -25, 0), X=Domain(0, 50), Y=Domain(0, 50), Z=Domain(0, 50)})
int = Integer(3)
G = Geometry([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])
smooth = SettingsQuality()
geo = Geometry(<brep referenced from the Rhino model>)
geo_2 = Geometry(<brep referenced from the Rhino model>)
geo_3 = Geometry(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)
mesh = MeshBrep(Brep=G, Settings=smooth)
mjoin = MeshJoin(Meshes=mesh)
arrbox = BoxArray(Geometry=mjoin, Cell=C, XCount=int, YCount=int, ZCount=int)  # -> flatten(Geometry), Transform
arrbox_2 = BoxArray(Geometry=geo_3, Cell=C, XCount=int, YCount=int, ZCount=1)  # -> flatten(Geometry), Transform
arrbox_3 = BoxArray(Geometry=geo_2, Cell=C, XCount=1, YCount=int, ZCount=int)  # -> flatten(Geometry), Transform
arrbox_4 = BoxArray(Geometry=geo, Cell=C, XCount=int, YCount=1, ZCount=int)  # -> flatten(Geometry), Transform
boxprop = BoxProperties(Box=C)  # -> Center, Diagonal, Area, Volume, Degeneracy
transform = Transform(Geometry=mjoin, Transform=arrbox.Transform)
multiplication = Multiplication(A=int, B=boxprop.Diagonal)
devec = DeconstructVector(Vector=multiplication)  # -> XComponent, YComponent, ZComponent
vec = VectorXYZ(XComponent=devec.XComponent, YComponent=0, ZComponent=0)  # -> Vector, Length
vec_2 = VectorXYZ(XComponent=0, YComponent=devec.YComponent, ZComponent=0)  # -> Vector, Length
vec_3 = VectorXYZ(XComponent=0, YComponent=0, ZComponent=devec.ZComponent)  # -> Vector, Length
move = Move(Geometry=arrbox_3.Geometry, Motion=vec.Vector)  # -> Geometry, Transform
move_2 = Move(Geometry=arrbox_4.Geometry, Motion=vec_2.Vector)  # -> Geometry, Transform
move_3 = Move(Geometry=arrbox_2.Geometry, Motion=vec_3.Vector)  # -> Geometry, Transform
mesh_2 = MeshBrep(
    Brep=[move_2.Geometry, move.Geometry, move_3.Geometry, arrbox_4.Geometry, arrbox_3.Geometry, arrbox_2.Geometry],
    Settings={GridMaxCount=0, GridMinCount=16, JaggedSeams=False, MaxEdgeLength=0, MinEdgeLength=0.0001, MinTolerance=0, Refine=True, RefineAngle=0, RelativeTolerance=0.65, SimplePlanes=True, Tolerance=0})
mjoin_2 = MeshJoin(Meshes=[mesh_2, transform])  # -> flatten(Mesh)
mjoin_3 = MeshJoin(Meshes=mjoin_2)
